# Grasshopper definition hops_plot_example.gh (Grasshopper 1.0.7)
# plug-ins: Hops

# MORE INFO AT: https://www.antoinemaes.com/plot-it
# &
# https://github.com/MaesAntoine/Hops_plots
panel = Panel("http://127.0.0.1:5000/")
data = Data(Tree({0;0;0;0}: [1], {0;0;0;1}: [3], {0;0;0;2}: [3], {0;0;0;3}: [3], {0;0;0;4}: [3], {0;0;0;5}: [1]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))
data_2 = Data(Tree({0;0;0;0}: [110], {0;0;0;1}: [89], {0;0;0;2}: [92], {0;0;0;3}: [92], {0;0;0;4}: [104], {0;0;0;5}: [122]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))
data_3 = Data(Tree({0;0;0;0}: [19], {0;0;0;1}: [17], {0;0;0;2}: [14], {0;0;0;3}: [16], {0;0;0;4}: [14], {0;0;0;5}: [19]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))

# ---- group: EXAMPLE_PROJECTS
# Data is organized as follows {A;B;C;D} :
# 
# - A: Which project the window is on
# - B: Which façade the window is on
# - C: Which floor the window is on
# - D: Which position (from left to right)the window is at
data_4 = Data(Tree({0;0;0;0}: [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], {0;0;0;1}: [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], {0;0;0;2}: [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], {0;0;0;3}: [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], {0;0;0;4}: [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], {0;0;1;0}: [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]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))

# ---- group: get currently supported plots and palettes from categories
concat = Concatenate(FragmentA=panel, FragmentB="presets")
hops = Hops(
    _Path=concat,
    PlotTypes="relational",
    PaletteTypes="diverging",
    CacheResultsInMemory=False,
    CacheSolveResults=False,
    RemoteDefinitionLocation="http://127.0.0.1:5000/presets",
    RemoteSolveVersion=(0, 1, 0),
    ShowInput_Enabled=False,
    ShowInput_Path=True,
    SynchronousSolve=True)  # -> AvailablePlots, AvailablePalettes

# ---- group: build dataframe to plot
datatree_nomenclature = Panel("""Project
Facade
Floor
Window""")
merge = Merge(Data1=data, Data2=data_2, Data3=data_3)
concat_2 = Concatenate(FragmentA=panel, FragmentB="dt_to_df")
data_in_datatree = Panel("""View
Solar
Radiation""")
hops_2 = Hops(
    _Path=concat_2,
    DataAsTree=merge,
    TreeStructureLabels=datatree_nomenclature,
    Datatype=data_in_datatree,
    CacheResultsInMemory=False,
    CacheSolveResults=False,
    RemoteDefinitionLocation="http://127.0.0.1:5000/dt_to_df",
    RemoteSolveVersion=(0, 1, 0),
    ShowInput_Enabled=False,
    ShowInput_Path=True,
    SynchronousSolve=True)

# ---- group: select the plot and the palette within their category
list = ValueList({"0", "1", "2", "3", "4", "5", "6", "7", "8"}, selected="2")
item = ListItem(List=hops.AvailablePlots, Index=list, Wrap=True)
item_2 = ListItem(List=hops.AvailablePalettes, Index=Slider(8, range=0..17), Wrap=True)
concat_3 = Concatenate(FragmentA=panel, FragmentB=item)
panel_2 = Panel(item)

# ----
item_3 = ListItem(List=flatten(hops_2), Index=0, Wrap=True)

# ---- group: plotting
plot = Button()
panel_3 = Panel("Facade")
panel_4 = Panel("Project")
panel_5 = Panel("View")
hops_3 = Hops(
    _Path=concat_3,
    Dataframe=item_3,
    XAxis=panel_3,
    YAxis=panel_5,
    Palette=item_2,
    Plot=Toggle(True),
    CacheResultsInMemory=False,
    CacheSolveResults=False,
    RemoteDefinitionLocation="http://127.0.0.1:5000/scatterplot",
    RemoteSolveVersion=(0, 1, 0),
    ShowInput_Enabled=False,
    ShowInput_Path=True,
    SynchronousSolve=True)

# ----
hops_4 = Hops(
    _Path=concat_3,
    Dataframe=item_3,
    XAxis=panel_3,
    YAxis=panel_5,
    Palette=item_2,
    CacheResultsInMemory=False,
    CacheSolveResults=False,
    RemoteDefinitionLocation="http://127.0.0.1:5000/scatterplot",
    RemoteSolveVersion=(0, 1, 0),
    ShowInput_Enabled=False,
    ShowInput_Path=True,
    SynchronousSolve=True)
# Component can fail either for abnormal inputs for the specified plot, or if the main thread has been caught in outside of the main loop.
# 
# If any of the two happens, you should restart the server.
# 
# No comments from devs for 300 days #hopsisdead
python = GhPythonScript(a0=hops_4)  # -> out, result
# ---------- python: Python ----------
import rhinoscriptsyntax as rs
import Rhino
import System.Drawing.Bitmap as Bitmap
import System.IO as IO
import base64

def display_image(base64_string):

    try:
        # Decode the base64 string to bytes
        image_bytes = base64.b64decode(base64_string)
        
        # Create a temporary file path
        temp_path = IO.Path.GetTempFileName() + ".png"
        
        # Write the image bytes to the file
        with open(temp_path, 'wb') as f:
            f.write(image_bytes)
        
        # Load the image as a Bitmap
        bitmap = Bitmap.FromFile(temp_path)
        
        # Create a rectangular surface
        width = 10  # You can adjust these values
        height = width * bitmap.Height / bitmap.Width
        plane = Rhino.Geometry.Plane.WorldXY
        rectangle = Rhino.Geometry.Rectangle3d(plane, width, height)
        surface = Rhino.Geometry.NurbsSurface.CreateFromCorners(
            rectangle.Corner(0),
            rectangle.Corner(1),
            rectangle.Corner(2),
            rectangle.Corner(3)
        )
        
        # Add the surface to the Rhino document
        doc = Rhino.RhinoDoc.ActiveDoc
        surface_id = doc.Objects.AddSurface(surface)
        
        # Create and add the texture
        material = Rhino.DocObjects.Material()
        material.SetBitmapTexture(temp_path)
        material_index = doc.Materials.Add(material)
        
        # Apply the material to the surface
        rhino_object = doc.Objects.Find(surface_id)
        if rhino_object:
            rhino_object.Attributes.MaterialSource = Rhino.DocObjects.ObjectMaterialSource.MaterialFromObject
            rhino_object.Attributes.MaterialIndex = material_index
            rhino_object.CommitChanges()
        
        # Refresh views
        rs.Redraw()
        
        return "Image displayed as textured surface in Rhino"
    except Exception as e:
        return "Error: " + str(e)

# Use this function in your Grasshopper Python component
# a0 should be connected to the output from your Hops component
result = display_image(a0)

# Output the result
a = result
# ---------- end python ----------
panel_6 = Panel(python.result)
